# Dynamo graph CreateTextLabels.dyn (Dynamo 2.5.2.7915)

code_block = CodeBlock { X_Start= -2000; Y_Start= -2000; Horisontal_Size = 43; Vertical_Size = 46; SizeOfQquare = 4000; }
generateTextAndStringsCoordinates = Python(IN[0]=code_block.X_Start, IN[1]=code_block.Y_Start, IN[2]=code_block.Horisontal_Size, IN[3]=code_block.Vertical_Size, IN[4]=code_block.SizeOfQquare)
# ---------- generateTextAndStringsCoordinates.python (36 lines) ----------
#Initial parameters
X_Start = IN[0]
Y_Start = IN[1]
Horiz_Size = IN[2]
Vert_Size = IN[3]
SizeOfSquare = IN[4]
# Outputs arrays
Text_List = list()
Points_List = list()

#Ayxilary function
def GetOneCoordStr(value):
	if value<10:
		StrFinish = '0' + str(value)
	elif value==0:
		StrFinish = '00'
	else:
		StrFinish = str(value)
	return StrFinish

#Function to getting text value
def GetStrCoordFromNum (x_value,y_value):
	return str(GetOneCoordStr(x_value)) + str(GetOneCoordStr(y_value))

for CoordX in range(0,Horiz_Size):
	for CoordY in range(0,Vert_Size):
		Text_List.append(GetStrCoordFromNum(CoordY,CoordX))
		Points_List.append(str(X_Start+CoordX*SizeOfSquare) + ',' + str(Y_Start+CoordY*SizeOfSquare) + ',' + str(0))
		CoordY+=1
	CoordX+=1

ToExport = list()
ToExport.append(Text_List)
ToExport.append(Points_List)
# Assign your output to the OUT variable.
OUT = ToExport
# ----------------------------------------
code_block_2 = CodeBlock(a=generateTextAndStringsCoordinates) { a[0]; a[1]; }
createPointsFromString = Python(IN[0]=code_block_2.out1)
# ---------- createPointsFromString.python (15 lines) ----------
import clr
clr.AddReference('ProtoGeometry')
from Autodesk.DesignScript.Geometry import Point
# Outputs arrays
Points_List = list()

for OneCoordStr in IN[0]:
	str_array = OneCoordStr.split(sep = ',')
	coords_array = []
	for OneCoordInStr in str_array:
		coords_array.append(float(OneCoordInStr))
	OnePoint3D = Point.ByCoordinates(coords_array[0],coords_array[1],coords_array[2])
	Points_List.append(OnePoint3D)
# Assign your output to the OUT variable.
OUT = Points_List
# ----------------------------------------
# note: Описание работы скрипта
# Данный скрипт расставляет текстовые метки (объектом MText) по прямогольным квадратам с равным шагом, записывая в значение метки номер квадарат по Y и по X.
code_block_3 = CodeBlock { 200; "0"; }
MTextHorizontalAttachment = HorizontalAttachment("По центру")
MTextVerticalAttachment = VerticalAttachment("Посередине")
current = Autodesk.AutoCAD.DynamoNodes.Document.Current()
modelSpace = Autodesk.AutoCAD.DynamoNodes.Document.ModelSpace(document=current)
create = Autodesk.AutoCAD.DynamoNodes.MText.Create(text=code_block_2.out0, insertionPoint=createPointsFromString, height=code_block_3.out0, horizontalAttachment=MTextHorizontalAttachment, verticalAttachment=MTextVerticalAttachment, layer=code_block_3.out1, block=modelSpace)
